# Grasshopper definition 170713_softBodyDemo.gh (Grasshopper 0.9.76)
# plug-ins: FlexHopper

vec = VectorXYZ(XComponent=15, YComponent=0, ZComponent=0)  # -> Vector, Length
mesh = Mesh(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)
demesh = DeconstructMesh(Mesh=mesh)  # -> Vertices, Faces, Colours, Normals
panel = Panel("""1
2
0
1.5
2
0.1
1.5
0.0
0.0""")
xy = XYPlane(Origin=Point(0, 0, 0))
move = Move(Geometry=mesh, Motion=vec.Vector)  # -> Geometry, Transform
particles = ParticlesFromPoints(Positions=demesh.Vertices)
soft = SoftFromMesh(Meshes=mesh, Velocities=Vector(0, 0, 0), Mass=1, SoftParams=panel, GroupIndex=2)
collgeometry = FlexCollisionGeometry(CollisionPlanes=flatten(xy))

# ----
# Shape matching constraints
number_slider = Slider(0.017, range=0..1)
series = Series(Start=0, Step=1, Count=104)
shape_matching = ConstraintShapeMatchingConstraint(ParticleIndices=series, Stiffness=number_slider)

soft_2 = SoftFromMesh(Meshes=move.Geometry, Velocities=Vector(0, 0, 0), Mass=1, SoftParams=panel, GroupIndex=1)
scene = FlexScene(Particles=flatten(particles), SoftBodies=flatten([soft_2, soft]), Constraints=flatten(shape_matching))
panel_2 = Panel(scene)
flex = FlexEngine(FlexCollisionGeometry=collgeometry, FlexScene=flatten(scene), LockMode=False, Reset=Button(), Go=Toggle(False))  # -> FlexObject, Information
panel_3 = Panel(flex.Information)
allsprings = GetAllSprings(FlexObject=flex.FlexObject, N=1)
allparts = GetAllParticles(FlexObject=flex.FlexObject, N=1)  # -> Points, Vector
